# Grasshopper definition terrain_node.gh (Grasshopper 1.0.7)
# plug-ins: NGon, Kangaroo2 Components, Section To XY, Speckle 2

# https://macad.speckle.xyz/streams/c5d5a515d0
growth = Slider(62, range=1..148)
analyze = Slider(0, range=0..4)
receive = Receive(
    AutoReceive=False,
    CurrentComponentState="expired",
    LastInfoMessage="Jacinto Jesús Moros Montañés @ 2022-02-20T23:40:53.636Z: Points (id:863abde263)",
    ReceiveOnOpen=False,
    ReceivedCommitId="863abde263",
    StreamWrapper="https://macad.speckle.xyz/streams/c5d5a515d0/commits/863abde263",
    selectedKitName="Objects")  # -> Info, Data
growth_2 = GetNumber(growth, AtLeast=1, AtMost=2147483647, Maximum=1.797693135e+308, Minimum=-1.797693135e+308)
analyze_2 = GetNumber(analyze, AtLeast=1, AtMost=1, Maximum=1.797693135e+308, Minimum=-1.797693135e+308)
geometry = Geometry([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])
series = Series(Start=0, Step=1, Count=growth_2)
list_item = ListItem(List=geometry, Index=series, Wrap=True)
explodemesh = ExplodeMesh(Mesh=list_item, Explode=invert(False))
data = Data(flatten(explodemesh))
area = Area(Geometry=data)  # -> Area, Centroid
cull_duplicates = CullDuplicates(Points=area.Centroid, Tolerance=0.1, CullMode=2)  # -> Points, Indices, Valence
list_item_2 = ListItem(List=data, Index=cull_duplicates.Indices, Wrap=True)
mesh_join = MeshJoin(Meshes=list_item_2)
combine_clean = CombineClean(Meshes=mesh_join)
subd_from_mesh = SubDFromMesh(Mesh=combine_clean, Creases=1, Corners=1, Interpolate=False)
mesh_from_subd = MeshFromSubD(SubD=subd_from_mesh, Density=2)
populate_geometry = PopulateGeometry(Geometry=mesh_from_subd, Count=growth_2, Seed=1)
stream_gate = StreamGate(Stream=mesh_from_subd, Gate=analyze_2)  # -> Target0, Target1, Target2, Target3, Target4
viewshed = Viewshed(Mesh=stream_gate.Target3, Viewpoint=populate_geometry)
concavity = Concavity(Mesh=stream_gate.Target0)  # -> Mesh, Colors, Tags, Concavity
roughness = Roughness(Mesh=stream_gate.Target2)  # -> Mesh, Colors, Tags, Roughness
elev = Elev(Mesh=stream_gate.Target1)  # -> Mesh, Colors, Tags
watershed = Watershed(Mesh=stream_gate.Target4, Points=populate_geometry)
subd_edges = SubDEdges(SubD=subd_from_mesh, NewFormatting=False)  # -> Line, Edge, Tag, Id
curvepoint = PointOnCurve(subd_edges.Line, parameter=0.5)
pt = ConstructPoint(XCoordinate=0, YCoordinate=0, ZCoordinate=0)
stream_filter = StreamFilter(Gate=analyze_2, Stream0=concavity.Mesh, Stream1=elev.Mesh, Stream2=roughness.Mesh, Stream3=viewshed, Stream4=watershed)
pull = PullPoint(Point=curvepoint, Geometry=pt, ClosestOnly=True)  # -> ClosestPoint, Distance
bnd = Bounds(Numbers=pull.Distance)
remap = RemapNumbers(Value=pull.Distance, Source=bnd, Target=Domain(0, 1))  # -> Mapped, Clipped
gradient = Gradient(
    LowerLimit=0,
    UpperLimit=1,
    Parameter=remap.Mapped,
    stops=[0: RGB(243, 57, 0), 0.1: RGB(236, 27, 60), 0.2: RGB(210, 0, 118), 0.3: RGB(103, 0, 120), 0.4: RGB(39, 72, 161), 0.5: RGB(1, 192, 229), 0.6: RGB(18, 178, 90), 0.7: RGB(79, 186, 8), 0.8: RGB(220, 237, 32), 0.9: RGB(247, 159, 20), 1: RGB(243, 57, 0)])

# ---- group: RH_OUT:Terrain
mesh = Mesh(stream_filter)

# ----
c_script = CSharpScript(crv=subd_edges.Line, color=gradient)  # -> out, A; inputs crv: Curve, color: Color
# ---------- c_script: C# ----------
    var c = color.R + "," + color.G + "," + color.B;
    crv.SetUserString("color", c);
    A = crv;
# ---------- end c_script ----------

# ---- group: RH_OUT:edges
curve = Curve(flatten(c_script.A))
