# Grasshopper definition city_generator.gh (Grasshopper 1.0.7)
# plug-ins: DeCodingSpaces, DeCodingSpaces_StreetNetwork_Utilities, Weaverbird, Pufferfish

street_minimum_distance = Slider(65, range=0..100)
street_min_lenght = Slider(594, range=0..1000)
street_max_lenght = Slider(365, range=0..1000)
plot_size = Slider(87, range=0..100)
number_slider = Slider(0.7, range=0..1)
linearscaling = Slider(8.8, range=0..100)
# Define the outter perimter and the square perimeter
perimeters = Point([Point(93.19672457, 868.8588858, 0), Point(555, 816, 0), Point(752, 342, 0), Point(461, -27, 0), Point(6, 48, 0), Point(-225, 458, 0), Point(185.7677198, 529.7211339, 0), Point(247, 544.3166818, 0), Point(360.3443289, 472, 0), Point(374, 345, 0), Point(261.3161094, 316, 0), Point(144.6492423, 430, 0)])
# Controls the buildings sizes
buildings1 = GetNumber(Slider(1, range=0..1), AtLeast=1, AtMost=2147483647, Maximum=1.797693135e+308, Minimum=-1.797693135e+308)
buildings2 = GetNumber(Slider(2, range=0..10), AtLeast=1, AtMost=2147483647, Maximum=1.797693135e+308, Minimum=-1.797693135e+308)
linear = GetNumber(Slider(9, range=0..10), AtLeast=1, AtMost=2147483647, Maximum=1.797693135e+308, Minimum=-1.797693135e+308)
streets2 = GetNumber(street_max_lenght, AtLeast=1, AtMost=2147483647, Maximum=1.797693135e+308, Minimum=-1.797693135e+308)
distance = GetNumber(street_minimum_distance, AtLeast=1, AtMost=2147483647, Maximum=1.797693135e+308, Minimum=-1.797693135e+308)
# Controls the Street Generator
# based on a cusztomized boundary (min. and max. length and max. distance)
streets1 = GetNumber(street_min_lenght, AtLeast=1, AtMost=2147483647, Maximum=1.797693135e+308, Minimum=-1.797693135e+308)
# Controls the plots size
plots = GetNumber(plot_size, AtLeast=1, AtMost=2147483647, Maximum=1.797693135e+308, Minimum=-1.797693135e+308)
get_point = GetPoint(perimeters, AtLeast=1, AtMost=2147483647, Realtime=True)
# Controls the terrain depthness
terrain = GetNumber(Slider(384, range=0..1000), AtLeast=1, AtMost=2147483647, Maximum=1.797693135e+308, Minimum=-1.797693135e+308)
# Controls the street widths (exponential and linear scaling)
number_slider_2 = Slider(1, range=1..4)
split = SplitList(List=get_point, Index="6")  # -> ListA, ListB
panel = Panel(split.ListA)
interpolate = Interpolate(Vertices=split.ListB, Degree=number_slider_2, Periodic=Toggle(True), KnotStyle=1)  # -> Curve, Length, Domain
panel_2 = Panel(split.ListB)
fillet = Fillet(Curve=interpolate.Curve, Radius=Slider(37, range=10..50))
interpolate_2 = Interpolate(Vertices=split.ListA, Degree=Slider(1, range=1..4), Periodic=Toggle(True), KnotStyle=1)  # -> Curve, Length, Domain
curve = Curve(interpolate.Curve)

# ---- group: Stret Generator
polyline = PolyLine(Vertices=split.ListA, Closed=Toggle(True))
street_network_generator = StreetNetworkGenerator(
    Boundary=polyline,
    IniStreets=curve,
    MinLength=streets1,
    MaxLength=streets2,
    MinDist=distance,
    RandomAngle=10,
    MaxArms=4,
    TreeDepth=7,
    ProbabilityToAddArms=1,
    SeedForRandom=-1)
streetnetworks = Geometry(street_network_generator)
length = Length(Curve=streetnetworks)
larger_than = LargerThan(FirstNumber=length, SecondNumber=0)  # -> LargerThan, OrEqualTo
cull_pattern = CullPattern(List=streetnetworks, CullPattern=larger_than.LargerThan)
network_to_segments = NetworkToSegments(NetworkGeometry=cull_pattern, ConvertCurves=True, ConversionAngle=0.2, Split=True)
network_smooth = NetworkSmooth(Network=network_to_segments, SnapThreshold=1, SnapToAnchorPointsOnly=False)
cul_de_sac_removal = CulDeSacRemoval(LineNetwork=network_smooth, Iterations=2)

# ----
boundary_surfaces = BoundarySurfaces(Edges=fillet)
fillet_2 = Fillet(Curve=reparameterize([interpolate_2.Curve, polyline]), Radius=Slider(100, range=10..100))
polygon_center = PolygonCenter(Polyline=interpolate_2.Curve)  # -> CenterV, CenterE, CenterA
boundary_surfaces_2 = BoundarySurfaces(Edges=fillet_2)
surface = Surface([boundary_surfaces_2, boundary_surfaces])
scale = Scale(Geometry=fillet_2, Center=polygon_center.CenterV, Factor=Slider(0.6, range=0..1))  # -> Geometry, Transform
unit_z = UnitZ(Factor=terrain)
control_points = ControlPoints(Curve=scale.Geometry)  # -> Points, Weights, Knots
move = Move(Geometry=control_points.Points, Motion=expr("-x", unit_z))  # -> Geometry, Transform
interpolate_3 = Interpolate(Vertices=move.Geometry, Degree=3, Periodic=True, KnotStyle=1)  # -> Curve, Length, Domain
ruled_surface = RuledSurface(CurveA=fillet_2, CurveB=interpolate_3.Curve)
cap_holes = CapHoles(Brep=ruled_surface)
deconstruct_brep = DeconstructBrep(Brep=cap_holes)  # -> Faces, Edges, Vertices
cull_index = CullIndex(List=deconstruct_brep.Faces, Indices=Slider(43, range=0..56), Wrap=True)

# ---- group: Street Network Analysis
line_segments = Line(cul_de_sac_removal)
citygraph = CityGraph(
    Path=line_segments,
    LengthCoefficient=1,
    AngularCoefficient=0,
    PairwiseShortestPaths=False,
    Radius=0,
    MaskInputString="000000001",
    PathInfoForPoints=False,
    UseGPU=True)  # -> BetweennessCentrality, ClosenessCentrality, Gravity, BetweennessCentralityWeighted, ClosenessCentralityWeighted, BetweennessCentralityNormalized, SupplementaryGeometry, PathsInformation, OutputGeometry
centrality = Number(citygraph.BetweennessCentrality)
logarithm = Logarithm(Value=centrality)
bounds = Bounds(Numbers=logarithm)
remap_numbers = RemapNumbers(Value=logarithm, Source=bounds, Target=Domain(0, 1))  # -> Mapped, Clipped
gradient = Gradient(
    LowerLimit=Slider(1, range=0..1),
    UpperLimit=Slider(0.595, range=0..1),
    Parameter=remap_numbers.Mapped,
    stops=[0: RGB(234, 38, 0), 0.25: RGB(234, 126, 0), 0.5: RGB(254, 244, 84), 0.75: RGB(173, 203, 249), 1: RGB(75, 107, 169)])
custom_preview = CustomPreview(Geometry=line_segments, Shader=gradient)

# ----
brep_join = BrepJoin(Breps=cull_index)  # -> Breps, Closed
mesh_brep = MeshBrep(
    Brep=brep_join.Breps,
    Settings={GridMaxCount=0, GridMinCount=16, JaggedSeams=False, MaxEdgeLength=0, MinEdgeLength=0.0001, MinTolerance=0, Refine=True, RefineAngle=0, RelativeTolerance=0.65, SimplePlanes=True, Tolerance=0})
weaverbird_s_catmull_clark_subdivision = WeaverbirdsCatmullClarkSubdivision(MeshCurves=mesh_brep, Level=1, SmoothNakedEdges=1)
expscaling = Slider(0.5, range=0.2..1.2)
unit_z_2 = UnitZ(Factor=Slider(1.5, range=0..10))
unit_z_3 = UnitZ(Factor=1)
unit_z_4 = UnitZ(Factor=Slider(1.8, range=0..10))
construct_domain = ConstructDomain(DomainStart=buildings1, DomainEnd=buildings2)
panel_3 = Panel("Buildable Area")
panel_4 = Panel("Extruded Terrain")
mjoin = MeshJoin(Meshes=[weaverbird_s_catmull_clark_subdivision, surface])
panel_5 = Panel("Buildings")
panel_6 = Panel("Plots")
clean_tree = CleanTree(RemoveNulls=True, RemoveInvalid=True, RemoveEmpty=False, Tree=flatten(mjoin))  # -> graft(Tree)
panel_7 = Panel(mjoin)

# ---- group: RH_OUT:mesh1
mesh = Mesh(simplify(flatten(clean_tree)))

# ----
polygons_from_lines = PolygonsFromLines(Lines=line_segments, LineValues=citygraph.BetweennessCentrality, MinBlockSize=Slider(7833, range=0..10000))  # -> Polygons, SynchronizedValues
power = Power(A=polygons_from_lines.SynchronizedValues, B=expscaling)
multiplication = Multiplication(A=power, B=linear)
custom_offset = CustomOffset(Polygons=polygons_from_lines.Polygons, OffsetValues=expr("x*-1", multiplication))  # -> OffsetedPolygons, Test
sort_list = SortList(Keys=power, ValuesValuesA=power)  # -> Keys, ValuesValuesA
number_slider_3 = Slider(3, range=0..15)
reverse_list = ReverseList(List=sort_list.Keys)
polyline_collapse = PolylineCollapse(Polyline=custom_offset.OffsetedPolygons, Tolerance=number_slider_3)  # -> Polyline, Count
simplify_curve = SimplifyCurve(Curve=polyline_collapse.Polyline, Tolerance=number_slider_3, AngleTolerance=10)  # -> Curve, Simplified
geometry = Geometry(simplify_curve.Curve)
list_item = ListItem(List=reverse_list, Index=0, Wrap=True)  # -> flatten(Item)
bounds_2 = Bounds(Numbers=list_item)
unit_z_5 = UnitZ(Factor=-0.1)
remap_numbers_2 = RemapNumbers(Value=list_item, Source=bounds_2, Target=Domain(0, 1))  # -> Mapped, Clipped

trim_with_region = TrimWithRegion(Curve=geometry, Region=curve)  # -> Inside, simplify(Outside)
curve_2 = Curve(flatten(trim_with_region.Outside))
clean_tree_2 = CleanTree(RemoveNulls=True, RemoveInvalid=True, RemoveEmpty=False, Tree=curve_2)  # -> graft(Tree)

boundary_surfaces_3 = BoundarySurfaces(Edges=clean_tree_2)
streetblocks = Curve(simplify(clean_tree_2))

clean_tree_3 = CleanTree(RemoveNulls=True, RemoveInvalid=True, RemoveEmpty=False, Tree=flatten(boundary_surfaces_3))  # -> graft(Tree)

move_2 = Move(Geometry=clean_tree_3, Motion=unit_z_5)  # -> Geometry, Transform

custom_preview_2 = CustomPreview(Geometry=move_2.Geometry, Material=ColourSwatch(SwatchColor=RGB(145, 145, 145)))
panel_8 = Panel(clean_tree_3)

# ----
# Parcelling single parameter
# Parcelling multi parameter
number_slider_4 = Slider(97, range=0..100)
construct_domain_2 = ConstructDomain(DomainStart=Slider(100, range=0..100), DomainEnd=number_slider_4)
bounds_3 = Bounds(Numbers=list_item)
geometry_2 = Geometry(streetblocks)
remap_numbers_3 = RemapNumbers(Value=list_item, Source=bounds_3, Target=construct_domain_2)  # -> Mapped, Clipped
customized_parameters = CustomizedParameters(
    ScalingFactor=1,
    Length=10,
    Angle=90,
    NChildren=2,
    TreeDepth=7,
    MinDistance=1,
    MaxRank=4,
    Rank=0,
    ParcelWidth=plots,
    Density=10,
    Seed=-1)
customized_parameters_2 = CustomizedParameters(
    ScalingFactor=1,
    Length=10,
    Angle=90,
    NChildren=2,
    TreeDepth=7,
    MinDistance=1,
    MaxRank=4,
    Rank=0,
    ParcelWidth=remap_numbers_3.Mapped,
    Density=10,
    Seed=-1)

slicing_tree_structure_for_parcels = SlicingTreeStructureForParcels(CustomizsedParameters=customized_parameters, Blocks=geometry_2)  # -> simplify(Parcels)
slicing_tree_structure_for_parcels_2 = SlicingTreeStructureForParcels(CustomizsedParameters=customized_parameters_2, Blocks=geometry_2)  # -> simplify(Parcels)
geometry_3 = Geometry(slicing_tree_structure_for_parcels)
geometry_4 = Geometry(slicing_tree_structure_for_parcels_2)
custom_preview_3 = CustomPreview(Geometry=geometry_4, Material=ColourSwatch(SwatchColor=RGB(61, 61, 61)))

# ---- group: Filter small parcels
geometry_5 = Geometry(geometry_3)
area = Area(Geometry=geometry_5)  # -> Area, Centroid
larger_than_2 = LargerThan(FirstNumber=area.Area, SecondNumber=Slider(100, range=0..1000))  # -> LargerThan, OrEqualTo
cull_pattern_2 = CullPattern(List=geometry_5, CullPattern=larger_than_2.LargerThan)

# ----
plots_2 = Geometry(cull_pattern_2)
streetblocks_2 = Curve(streetblocks)
buildable_area = BuildableArea(Parcels=plots_2, Blocks=streetblocks_2, RoadSetback=-5, SideSetback=-3, BackSetback=-3, Tolerance=0.785398)
fillet_3 = Fillet(Curve=streetblocks, Radius="10")
fillet_4 = Fillet(Curve=buildable_area, Radius="10")
offset_curve = OffsetCurve(Curve=fillet_3, Distance=expr("-x", "5"), Corners=1)
fillet_5 = Fillet(Curve=offset_curve, Radius="10")
move_3 = Move(Geometry=fillet_4, Motion=unit_z_2)  # -> Geometry, Transform
move_4 = Move(Geometry=fillet_5, Motion=unit_z_2)  # -> Geometry, Transform
ruled_surface_2 = RuledSurface(CurveA=fillet_3, CurveB=move_4.Geometry)
extrude = Extrude(Base=ruled_surface_2, Direction=unit_z_3)
move_5 = Move(Geometry=move_3.Geometry, Motion=unit_z_4)  # -> Geometry, Transform
clean_tree_4 = CleanTree(RemoveNulls=True, RemoveInvalid=True, RemoveEmpty=False, Tree=flatten(extrude))  # -> graft(Tree)
custom_preview_4 = CustomPreview(
    Geometry=clean_tree_4,
    Material={diffuse=RGB(221, 160, 221), emission=RGB(66, 48, 66), shine=0.5, specular=RGB(255, 255, 255), transparency=0})
ruled_surface_3 = RuledSurface(CurveA=move_5.Geometry, CurveB=move_3.Geometry)
boundary_surfaces_4 = BoundarySurfaces(Edges=move_5.Geometry)
area_2 = Area(Geometry=boundary_surfaces_4)  # -> Area, Centroid
move_6 = Move(Geometry=area_2.Centroid, Motion=Vector(0, 0, 10))  # -> Geometry, Transform
deconstruct_brep_2 = DeconstructBrep(Brep=boundary_surfaces_4)  # -> Faces, Edges, Vertices
point_list = PointList(Points=flatten(move_6.Geometry), Size=Slider(15, range=0..20))
area_3 = Area(Geometry=boundary_surfaces_4)  # -> flatten(Area), Centroid
bounds_4 = Bounds(Numbers=area_3.Area)
remap_numbers_4 = RemapNumbers(Value=area_3.Area, Source=bounds_4, Target=construct_domain)  # -> Mapped, Clipped

mesh_2 = Mesh([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])
mesh_3 = Mesh([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])
mesh_4 = Mesh([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])
mesh_5 = Mesh([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])
mesh_6 = Mesh([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])
mesh_7 = Mesh([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])
mesh_8 = Mesh([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])
mesh_9 = Mesh([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])
mesh_10 = Mesh([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])
mesh_11 = Mesh([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])
mesh_12 = Mesh([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])
mesh_13 = Mesh([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])
mesh_14 = Mesh([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])
mesh_15 = Mesh([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])
group = Group(Objects=mesh_2)
group_2 = Group(Objects=mesh_3)
group_3 = Group(Objects=mesh_11)
group_4 = Group(Objects=mesh_12)
group_5 = Group(Objects=mesh_4)
group_6 = Group(Objects=mesh_5)
group_7 = Group(Objects=mesh_6)
group_8 = Group(Objects=mesh_7)
group_9 = Group(Objects=mesh_8)
group_10 = Group(Objects=mesh_13)
group_11 = Group(Objects=mesh_14)
group_12 = Group(Objects=mesh_9)
group_13 = Group(Objects=mesh_10)
group_14 = Group(Objects=mesh_15)
bounding_rectangle = BoundingRectangle(Geometry=group_7, Plane=PlaneXY(0, 0, 0), Axis=0, Slide=0, Union=True)  # -> Bounding, DimensionX, DimensionY
bounding_rectangle_2 = BoundingRectangle(Geometry=group, Plane=PlaneXY(0, 0, 0), Axis=0, Slide=0, Union=True)  # -> Bounding, DimensionX, DimensionY
bounding_rectangle_3 = BoundingRectangle(Geometry=group_2, Plane=PlaneXY(0, 0, 0), Axis=0, Slide=0, Union=True)  # -> Bounding, DimensionX, DimensionY
bounding_rectangle_4 = BoundingRectangle(Geometry=group_3, Plane=PlaneXY(0, 0, 0), Axis=0, Slide=0, Union=True)  # -> Bounding, DimensionX, DimensionY
bounding_rectangle_5 = BoundingRectangle(Geometry=group_4, Plane=PlaneXY(0, 0, 0), Axis=0, Slide=0, Union=True)  # -> Bounding, DimensionX, DimensionY
bounding_rectangle_6 = BoundingRectangle(Geometry=group_5, Plane=PlaneXY(0, 0, 0), Axis=0, Slide=0, Union=True)  # -> Bounding, DimensionX, DimensionY
bounding_rectangle_7 = BoundingRectangle(Geometry=group_6, Plane=PlaneXY(0, 0, 0), Axis=0, Slide=0, Union=True)  # -> Bounding, DimensionX, DimensionY
bounding_rectangle_8 = BoundingRectangle(Geometry=group_9, Plane=PlaneXY(0, 0, 0), Axis=0, Slide=0, Union=True)  # -> Bounding, DimensionX, DimensionY
bounding_rectangle_9 = BoundingRectangle(Geometry=group_8, Plane=PlaneXY(0, 0, 0), Axis=0, Slide=0, Union=True)  # -> Bounding, DimensionX, DimensionY
bounding_rectangle_10 = BoundingRectangle(Geometry=group_10, Plane=PlaneXY(0, 0, 0), Axis=0, Slide=0, Union=True)  # -> Bounding, DimensionX, DimensionY
bounding_rectangle_11 = BoundingRectangle(Geometry=group_10, Plane=PlaneXY(0, 0, 0), Axis=0, Slide=0, Union=True)  # -> Bounding, DimensionX, DimensionY
bounding_rectangle_12 = BoundingRectangle(Geometry=group_11, Plane=PlaneXY(0, 0, 0), Axis=0, Slide=0, Union=True)  # -> Bounding, DimensionX, DimensionY
bounding_rectangle_13 = BoundingRectangle(Geometry=group_12, Plane=PlaneXY(0, 0, 0), Axis=0, Slide=0, Union=True)  # -> Bounding, DimensionX, DimensionY
bounding_rectangle_14 = BoundingRectangle(Geometry=group_13, Plane=PlaneXY(0, 0, 0), Axis=0, Slide=0, Union=True)  # -> Bounding, DimensionX, DimensionY
area_4 = Area(Geometry=bounding_rectangle.Bounding)  # -> Area, Centroid
area_5 = Area(Geometry=bounding_rectangle_8.Bounding)  # -> Area, Centroid
area_6 = Area(Geometry=bounding_rectangle_9.Bounding)  # -> Area, Centroid
area_7 = Area(Geometry=bounding_rectangle_10.Bounding)  # -> Area, Centroid
area_8 = Area(Geometry=bounding_rectangle_11.Bounding)  # -> Area, Centroid
area_9 = Area(Geometry=bounding_rectangle_2.Bounding)  # -> Area, Centroid
area_10 = Area(Geometry=bounding_rectangle_3.Bounding)  # -> Area, Centroid
area_11 = Area(Geometry=bounding_rectangle_4.Bounding)  # -> Area, Centroid
area_12 = Area(Geometry=bounding_rectangle_5.Bounding)  # -> Area, Centroid
area_13 = Area(Geometry=bounding_rectangle_6.Bounding)  # -> Area, Centroid
area_14 = Area(Geometry=bounding_rectangle_7.Bounding)  # -> Area, Centroid
area_15 = Area(Geometry=bounding_rectangle_12.Bounding)  # -> Area, Centroid
area_16 = Area(Geometry=bounding_rectangle_13.Bounding)  # -> Area, Centroid
area_17 = Area(Geometry=bounding_rectangle_14.Bounding)  # -> Area, Centroid
point = Point(area_4.Centroid)
point_2 = Point(area_6.Centroid)
point_3 = Point(area_5.Centroid)
point_4 = Point(area_7.Centroid)
point_5 = Point(area_8.Centroid)
point_6 = Point(area_13.Centroid)
point_7 = Point(area_10.Centroid)
point_8 = Point(area_11.Centroid)
point_9 = Point(area_14.Centroid)
point_10 = Point(area_12.Centroid)
point_11 = Point(area_15.Centroid)
point_12 = Point(area_16.Centroid)
point_13 = Point(area_17.Centroid)
point_14 = Point(area_9.Centroid)
scale_2 = Scale(
    Geometry=[group, group_2, group_3, group_4, group_5, group_6, group_7, group_8, group_9, group_10, group_11, group_12, group_13],
    Center=[area_9.Centroid, area_10.Centroid, area_11.Centroid, area_12.Centroid, area_13.Centroid, area_14.Centroid, area_4.Centroid, area_6.Centroid, area_5.Centroid, area_7.Centroid, area_8.Centroid, area_15.Centroid, area_16.Centroid, area_17.Centroid, point_13],
    Factor=remap_numbers_4.Mapped)  # -> Geometry, Transform

merge = Merge(
    Data1=area_9.Centroid,
    Data2=area_10.Centroid,
    Data3=area_11.Centroid,
    Data4=area_12.Centroid,
    Data5=area_13.Centroid,
    Data6=area_14.Centroid,
    Data7=area_4.Centroid,
    Data8=area_6.Centroid,
    Data9=area_5.Centroid,
    Data10=area_7.Centroid,
    Data11=area_8.Centroid,
    Data12=area_15.Centroid,
    Data13=area_16.Centroid,
    Data14=area_17.Centroid)
join = BrepJoin(Breps=[ruled_surface_3, boundary_surfaces_4])  # -> Breps, Closed
join_2 = BrepJoin(Breps=[ruled_surface_2, clean_tree_4])  # -> Breps, Closed
mesh_16 = MeshBrep(
    Brep=join.Breps,
    Settings={GridMaxCount=0, GridMinCount=16, JaggedSeams=False, MaxEdgeLength=0, MinEdgeLength=0.0001, MinTolerance=0, Refine=True, RefineAngle=0, RelativeTolerance=0.65, SimplePlanes=True, Tolerance=0})
mesh_17 = MeshBrep(
    Brep=join_2.Breps,
    Settings={GridMaxCount=0, GridMinCount=16, JaggedSeams=False, MaxEdgeLength=0, MinEdgeLength=0.0001, MinTolerance=0, Refine=True, RefineAngle=0, RelativeTolerance=0.65, SimplePlanes=True, Tolerance=0})
clean_tree_5 = CleanTree(RemoveNulls=True, RemoveInvalid=True, RemoveEmpty=False, Tree=flatten(mesh_17))  # -> graft(Tree)
clean_tree_6 = CleanTree(RemoveNulls=True, RemoveInvalid=True, RemoveEmpty=False, Tree=flatten(mesh_16))  # -> graft(Tree)

# ---- group: RH_OUT:mesh2
mesh_18 = Mesh(simplify(flatten(clean_tree_5)))

# ---- group: RH_OUT:mesh3
mesh_19 = Mesh(simplify(flatten(clean_tree_6)))

# ----
move_to_point = MoveToPoint(Geometry=scale_2.Geometry, PointA=merge, PointB=flatten(area_2.Centroid))  # -> Moved, Vector, Transform
bounding_box = BoundingBox(Content=move_to_point.Moved, Plane=PlaneXY(0, 0, 0))  # -> Box, Box_2
surface_closest_point = SurfaceClosestPoint(Point=area_3.Centroid, Surface=boundary_surfaces_4)  # -> Point, UVPoint, Distance
volume = Volume(Geometry=bounding_box.Box)  # -> Volume, Centroid
evaluate_surface = EvaluateSurface(Surface=boundary_surfaces_4, Point=surface_closest_point.UVPoint)  # -> Point, Normal, UDirection, VDirection, flatten(Frame)
xy_plane = XYPlane(Origin=volume.Centroid)

flippln = FlipPlane(Plane=evaluate_surface.Frame, FlipX=False, FlipY=False, FlipZ=True)  # -> Flipped, R

orient = Orient(Geometry=move_to_point.Moved, Source=xy_plane, Target=flippln.Flipped)  # -> Geometry, Transform

movetoplane = MoveToPlane(Geometry=orient.Geometry, Plane=PlaneXY(0, 0, 0), Above=True, Below=True)  # -> Geometry, Transform
ungroup = Ungroup(Group=movetoplane.Geometry)  # -> simplify(Objects)

custom_preview_5 = CustomPreview(Geometry=ungroup, Material=ColourSwatch(SwatchColor=RGB(255, 255, 255)))

mjoin_2 = MeshJoin(Meshes=ungroup)
clean_tree_7 = CleanTree(RemoveNulls=True, RemoveInvalid=True, RemoveEmpty=False, Tree=flatten(mjoin_2))  # -> graft(Tree)

# ---- group: RH_OUT:mesh4
mesh_20 = Mesh(simplify(flatten(clean_tree_7)))
