# Grasshopper definition import_asc.gh (Grasshopper 1.0.7)
# plug-ins: Docofossor

resolucion = Slider(20, range=0..20)
file_path = FilePath("D:\ARQUITECTURA\01. Grasshopper DAETSAM\05. EN CONSTRUCCION\TERRAIN ANALYTICS\EXERCISES\TA_01_Import ASC\PNOA_MDT05_ETRS89_HU30_0533_LID.asc")
upload_asc = GetString(file_path, AtLeast=1, AtMost=1)
resolution = GetNumber(resolucion, AtLeast=1, AtMost=2147483647, Maximum=1.797693135e+308, Minimum=-1.797693135e+308)
import_asc = ImportASC(F=upload_asc, N=resolution)
grid_shift = GridShift(Df=import_asc)
grid_info = GridInfo(Df=grid_shift)
grid_mesh = GridMesh(Df=grid_shift)
panel = Panel(grid_info)
deconstruct_mesh = DeconstructMesh(Mesh=grid_mesh)  # -> Vertices, Faces, Colours, Normals
explode_tree = ExplodeTree(Data=graft(panel))  # -> _0000, _0001, _0002, _0003, _0004, _0005, _0006, _0007, _0008
deconstruct = Deconstruct(Point=deconstruct_mesh.Vertices)  # -> XComponent, YComponent, ZComponent

# ---- group: RH_OUT:max_z
data = Data(flatten(explode_tree._0008))  # disabled

# ---- group: RH_OUT:min_z
data_2 = Data(flatten(explode_tree._0007))  # disabled

# ----
bounds = Bounds(Numbers=deconstruct.ZComponent)
max_z = Panel(data)  # disabled
min_z = Panel(data_2)  # disabled
deconstruct_domain = DeconstructDomain(Domain=bounds)  # -> Start, End
gradient = Gradient(
    LowerLimit=deconstruct_domain.Start,
    UpperLimit=deconstruct_domain.End,
    Parameter=deconstruct.ZComponent,
    stops=[0: RGB(41, 141, 255), 0.121: RGB(205, 222, 111), 0.209: RGB(141, 173, 76), 0.3: RGB(86, 145, 67), 0.43: RGB(72, 107, 39), 1: RGB(255, 255, 255)])
construct_mesh = ConstructMesh(Vertices=deconstruct_mesh.Vertices, Faces=deconstruct_mesh.Faces, Colours=gradient)

# ---- group: RH_OUT:Terrain
mesh = Mesh(construct_mesh)
