# Grasshopper definition import_heightmapper.gh (Grasshopper 1.0.7)
# plug-ins: Section To XY

resolucion_de_la_imagen = Slider(1, range=1..100)
m = Slider(100, range=0..100)
path = FilePath("D:\MASTER IAAC\BIMSC21\CLOUD-BASED DATA MANAGMENT[CRHINO.COMPUTE]\WEEK 01\HOPS\Heightmapper\Example Images\heightmapper-1641918600508.png")
resolution_image = GetInteger(resolucion_de_la_imagen, AtLeast=1, AtMost=2147483647, Maximum=100, Minimum=-2147483648)
maximum_height = GetNumber(m, AtLeast=1, AtMost=2147483647, Maximum=1.797693135e+308, Minimum=-1.797693135e+308)
image_file = GetString(path, AtLeast=1, AtMost=1)
import_image = ImportImage(File=image_file)
bounding_box = BoundingBox(Content=import_image, Plane=PlaneXY(0, 0, 0))  # -> Box, Box_2
dimensions = Dimensions(Surface=bounding_box.Box)  # -> UDimension, VDimension
analyze = Slider(4, range=0..4)
division = Division(A=dimensions.UDimension, B=10)
division_2 = Division(A=dimensions.VDimension, B=10)
point = Point(<point referenced from the Rhino model>)
points = GetPoint(point, AtLeast=1, AtMost=2147483647, Realtime=True)
analyze_2 = GetNumber(analyze, AtLeast=1, AtMost=1, Maximum=1.797693135e+308, Minimum=-1.797693135e+308)
division_3 = Division(A=division, B=resolution_image)
division_4 = Division(A=division_2, B=resolution_image)
import_image_2 = ImportImage(File=image_file, XSamples=division_3, YSamples=division_4)
deconstruct_mesh = DeconstructMesh(Mesh=import_image_2)  # -> Vertices, Faces, Colours, Normals
split_ahsl = SplitAHSL(Colour=deconstruct_mesh.Colours)  # -> Alpha, Hue, Saturation, Luminance
construct_domain = ConstructDomain(DomainStart=0, DomainEnd=maximum_height)
deconstruct = Deconstruct(Point=deconstruct_mesh.Vertices)  # -> XComponent, YComponent, ZComponent
remap_numbers = RemapNumbers(Value=split_ahsl.Luminance, Source=Domain(0, 1), Target=construct_domain)  # -> Mapped, Clipped
construct_point = ConstructPoint(XCoordinate=deconstruct.XComponent, YCoordinate=deconstruct.YComponent, ZCoordinate=remap_numbers.Mapped)
construct_mesh = ConstructMesh(Vertices=construct_point, Faces=deconstruct_mesh.Faces, Colours=deconstruct_mesh.Colours)
mesh_closest_point = MeshClosestPoint(Point=points, Mesh=construct_mesh)  # -> Point, Index, Parameter
stream_gate = StreamGate(Stream=construct_mesh, Gate=analyze_2)  # -> Target0, Target1, Target2, Target3, Target4
viewshed = Viewshed(Mesh=stream_gate.Target3, Viewpoint=mesh_closest_point.Point)
roughness = Roughness(Mesh=stream_gate.Target2)  # -> Mesh, Colors, Tags, Roughness
watershed = Watershed(Mesh=stream_gate.Target4, Points=mesh_closest_point.Point)
elev = Elev(Mesh=stream_gate.Target1)  # -> Mesh, Colors, Tags
concavity = Concavity(Mesh=stream_gate.Target0)  # -> Mesh, Colors, Tags, Concavity
stream_filter = StreamFilter(Gate=analyze_2, Stream0=concavity.Mesh, Stream1=elev.Mesh, Stream2=roughness.Mesh, Stream3=viewshed, Stream4=watershed)

# ---- group: RH_OUT:Terrain
mesh = Mesh(stream_filter)
