# Grasshopper definition import_terrain_02.gh (Grasshopper 1.0.7)

resolucion_de_la_imagen = Slider(4, range=1..100)
path = FilePath("C:\Users\JACINTO MOROS\Downloads\heightmapper-1647050810706.png")
resolution_image = GetInteger(resolucion_de_la_imagen, AtLeast=1, AtMost=2147483647, Maximum=100, Minimum=-2147483648)
image_file = GetString(path, AtLeast=1, AtMost=1)
import_image = ImportImage(File=image_file)
min_elevation = GetString("0", AtLeast=1, AtMost=2147483647)
max_elevation = GetString("1112", AtLeast=1, AtMost=2147483647)
bounding_box = BoundingBox(Content=import_image, Plane=PlaneXY(0, 0, 0))  # -> Box, Box_2
dimensions = Dimensions(Surface=bounding_box.Box)  # -> UDimension, VDimension
division = Division(A=dimensions.UDimension, B=resolution_image)
division_2 = Division(A=dimensions.VDimension, B=resolution_image)
import_image_2 = ImportImage(File=image_file, XSamples=division, YSamples=division_2)
deconstruct_mesh = DeconstructMesh(Mesh=import_image_2)  # -> Vertices, Faces, Colours, Normals
split_ahsl = SplitAHSL(Colour=deconstruct_mesh.Colours)  # -> Alpha, Hue, Saturation, Luminance
construct_domain = ConstructDomain(DomainStart=min_elevation, DomainEnd=max_elevation)
construct_domain_2 = ConstructDomain(DomainStart=0, DomainEnd=Slider(10, range=0..10))
deconstruct = Deconstruct(Point=deconstruct_mesh.Vertices)  # -> XComponent, YComponent, ZComponent
remap_numbers = RemapNumbers(Value=split_ahsl.Luminance, Source=construct_domain_2, Target=construct_domain)  # -> Mapped, Clipped
bounds = Bounds(Numbers=remap_numbers.Mapped)
construct_point = ConstructPoint(XCoordinate=deconstruct.XComponent, YCoordinate=deconstruct.YComponent, ZCoordinate=remap_numbers.Mapped)
deconstruct_domain = DeconstructDomain(Domain=bounds)  # -> Start, End
gradient = Gradient(
    LowerLimit=deconstruct_domain.Start,
    UpperLimit=deconstruct_domain.End,
    Parameter=remap_numbers.Mapped,
    stops=[0: RGB(41, 141, 255), 0.121: RGB(205, 222, 111), 0.209: RGB(141, 173, 76), 0.3: RGB(86, 145, 67), 0.43: RGB(72, 107, 39), 1: RGB(255, 255, 255)])
construct_mesh = ConstructMesh(Vertices=construct_point, Faces=deconstruct_mesh.Faces, Colours=gradient)

# ---- group: RH_OUT:Terrain
mesh = Mesh(construct_mesh)
